# Grasshopper definition trigonometry-basics.gh (Grasshopper 1.0.7)
# Copyright: GNU General Public License 3.0

# trigonometry basics
# curves
u = Slider(2, range=0..10)
u_2 = Slider(2, range=0..10)
# translation
u_3 = Slider(2, range=0..10)
a = Slider(1.5, range=0..10)
b = Slider(1, range=0..10)
# scaling
u_4 = Slider(2, range=0..10)
r = Slider(0.5, range=-2..2)
# cutting
u_5 = Slider(1, range=0..10)
# modulation
u_6 = Slider(2, range=0..10)
w = Slider(0.5, range=0..10)
# amplitude
u_7 = Slider(2, range=0..10)
A = Slider(2, range=0..10)
# dampening
u_8 = Slider(2, range=0..10)
h = Slider(2, range=0..10)
# expression
u_9 = Slider(2, range=0..10)
# decay function
u_10 = Slider(4, range=0..10)
w_2 = Slider(0.5, range=0..10)
A_2 = Slider(2, range=0..10)
halflife = Slider(4, range=0..10)
# series
u_11 = Slider(4, range=0..10)
w_3 = Slider(0.5, range=0..10)
A_3 = Slider(1.2, range=0..10)
step = Slider(1, range=0..10)
count = Slider(10, range=0..100)
pi = Pi(Factor=u_8)
pi_2 = Pi(Factor=u_9)
pi_3 = Pi(Factor=u_10)
pi_4 = Pi(Factor=u_11)
pi_5 = Pi(Factor=u_7)
pi_6 = Pi(Factor=u_3)
pi_7 = Pi(Factor=u_4)
pi_8 = Pi(Factor=u_5)
pi_9 = Pi(Factor=u_6)
pi_10 = Pi(Factor=u)
pi_11 = Pi(Factor=u_2)
range = Range(Domain=pi, Steps=1000)
range_2 = Range(Domain=pi_2, Steps=1000)
range_3 = Range(Domain=pi_3, Steps=1000)
range_4 = Range(Domain=pi_4, Steps=1000)
range_5 = Range(Domain=pi_5, Steps=1000)
range_6 = Range(Domain=pi_6, Steps=1000)
range_7 = Range(Domain=pi_7, Steps=100)
range_8 = Range(Domain=pi_8, Steps=100)
range_9 = Range(Domain=pi_9, Steps=1000)
range_10 = Range(Domain=pi_10, Steps=1000)
range_11 = Range(Domain=pi_11, Steps=1000)
series = Series(Start="1", Step=step, Count=count)
division = Division(A=range_9, B=w)
expression = Expression(x=range_2, Expression="sin(x)")
expression_2 = Expression(x=range_3, w=w_2, A=A_2, l=halflife, Expression="sin(x/w)*A*(0.5^(x/l))")
expression_3 = Expression(x=range_4, w=w_3, A=A_3, l=graft(series), Expression="sin(x/w)*A*(0.5^(x/l))")
sine = Sine(Value=range_8)
sine_2 = Sine(Value=range_5)
sine_3 = Sine(Value=range_10)
cosine = Cosine(Value=range_11)
sine_4 = Sine(Value=range_6)
sine_5 = Sine(Value=range_7)
sine_6 = Sine(Value=range)
division_2 = Division(A=range, B=h)
sine_7 = Sine(Value=division)
multiplication = Multiplication(A=sine_2, B=A)
construct_point = ConstructPoint(XCoordinate=range_8, YCoordinate=sine, ZCoordinate=0)
construct_point_2 = ConstructPoint(XCoordinate=range_10, YCoordinate=sine_3, ZCoordinate=0)
construct_point_3 = ConstructPoint(XCoordinate=range_11, YCoordinate=cosine, ZCoordinate=0)
construct_point_4 = ConstructPoint(XCoordinate=range_2, YCoordinate=expression, ZCoordinate=0)
multiplication_2 = Multiplication(A=range_7, B=r)
multiplication_3 = Multiplication(A=sine_5, B=r)
addition = Addition(A=range_6, B=a)
addition_2 = Addition(A=sine_4, B=b)
power = Power(A="0.5", B=division_2)
construct_point_5 = ConstructPoint(XCoordinate=range_5, YCoordinate=multiplication, ZCoordinate=0)
construct_point_6 = ConstructPoint(XCoordinate=range_9, YCoordinate=sine_7, ZCoordinate=0)
interpolate = Interpolate(Vertices=construct_point, Degree=3, Periodic=False, KnotStyle=1)  # -> Curve, Length, Domain
interpolate_2 = Interpolate(Vertices=construct_point_2, Degree=3, Periodic=False, KnotStyle=1)  # -> Curve, Length, Domain
interpolate_3 = Interpolate(Vertices=construct_point_3, Degree=3, Periodic=False, KnotStyle=1)  # -> Curve, Length, Domain
construct_point_7 = ConstructPoint(XCoordinate=addition, YCoordinate=addition_2, ZCoordinate=0)
construct_point_8 = ConstructPoint(XCoordinate=multiplication_2, YCoordinate=multiplication_3, ZCoordinate=0)
construct_point_9 = ConstructPoint(XCoordinate=range_3, YCoordinate=expression_2, ZCoordinate=0)
construct_point_10 = ConstructPoint(XCoordinate=range_4, YCoordinate=expression_3, ZCoordinate=0)
interpolate_4 = Interpolate(Vertices=construct_point_4, Degree=3, Periodic=False, KnotStyle=1)  # -> Curve, Length, Domain
multiplication_4 = Multiplication(A=sine_6, B=power)
interpolate_5 = Interpolate(Vertices=construct_point_5, Degree=3, Periodic=False, KnotStyle=1)  # -> Curve, Length, Domain
interpolate_6 = Interpolate(Vertices=construct_point_6, Degree=3, Periodic=False, KnotStyle=1)  # -> Curve, Length, Domain
construct_point_11 = ConstructPoint(XCoordinate=range, YCoordinate=multiplication_4, ZCoordinate=0)
curve = Curve(interpolate_2.Curve)
curve_2 = Curve(interpolate_3.Curve)
curve_3 = Curve(interpolate.Curve)
interpolate_7 = Interpolate(Vertices=construct_point_7, Degree=3, Periodic=False, KnotStyle=1)  # -> Curve, Length, Domain
interpolate_8 = Interpolate(Vertices=construct_point_8, Degree=3, Periodic=False, KnotStyle=1)  # -> Curve, Length, Domain
interpolate_9 = Interpolate(Vertices=construct_point_10, Degree=3, Periodic=False, KnotStyle=1)  # -> flatten(Curve), Length, Domain
curve_4 = Curve(interpolate_4.Curve)
interpolate_10 = Interpolate(Vertices=construct_point_9, Degree=3, Periodic=False, KnotStyle=1)  # -> Curve, Length, Domain
curve_5 = Curve(interpolate_6.Curve)
curve_6 = Curve(interpolate_5.Curve)
interpolate_11 = Interpolate(Vertices=construct_point_11, Degree=3, Periodic=False, KnotStyle=1)  # -> Curve, Length, Domain
curve_7 = Curve(interpolate_7.Curve)
curve_8 = Curve(interpolate_8.Curve)
curve_9 = Curve(interpolate_10.Curve)
curve_10 = Curve(interpolate_9.Curve)
curve_11 = Curve(interpolate_11.Curve)
# circles
u_12 = Slider(2, range=0..10)
# translation
u_13 = Slider(2, range=0..10)
a_2 = Slider(1, range=0..10)
b_2 = Slider(1, range=0..10)
# scaling
u_14 = Slider(2, range=0..10)
r_2 = Slider(0.5, range=-2..2)
# cutting
u_15 = Slider(1, range=0..10)
pi_12 = Pi(Factor=u_14)
pi_13 = Pi(Factor=u_13)
pi_14 = Pi(Factor=u_12)
pi_15 = Pi(Factor=u_15)
range_12 = Range(Domain=pi_12, Steps=100)
range_13 = Range(Domain=pi_13, Steps=1000)
range_14 = Range(Domain=pi_14, Steps=1000)
range_15 = Range(Domain=pi_15, Steps=100)
sine_8 = Sine(Value=range_14)
cosine_2 = Cosine(Value=range_14)
sine_9 = Sine(Value=range_15)
cosine_3 = Cosine(Value=range_15)
cosine_4 = Cosine(Value=range_13)
sine_10 = Sine(Value=range_13)
sine_11 = Sine(Value=range_12)
cosine_5 = Cosine(Value=range_12)
construct_point_12 = ConstructPoint(XCoordinate=sine_8, YCoordinate=cosine_2, ZCoordinate=0)
construct_point_13 = ConstructPoint(XCoordinate=sine_9, YCoordinate=cosine_3, ZCoordinate=0)
multiplication_5 = Multiplication(A=sine_11, B=r_2)
multiplication_6 = Multiplication(A=cosine_5, B=r_2)
addition_3 = Addition(A=sine_10, B=a_2)
addition_4 = Addition(A=cosine_4, B=b_2)
interpolate_12 = Interpolate(Vertices=construct_point_12, Degree=3, Periodic=False, KnotStyle=1)  # -> Curve, Length, Domain
interpolate_13 = Interpolate(Vertices=construct_point_13, Degree=3, Periodic=False, KnotStyle=1)  # -> Curve, Length, Domain
construct_point_14 = ConstructPoint(XCoordinate=multiplication_5, YCoordinate=multiplication_6, ZCoordinate=0)
construct_point_15 = ConstructPoint(XCoordinate=addition_3, YCoordinate=addition_4, ZCoordinate=0)
curve_12 = Curve(interpolate_12.Curve)
interpolate_14 = Interpolate(Vertices=construct_point_14, Degree=3, Periodic=False, KnotStyle=1)  # -> Curve, Length, Domain
curve_13 = Curve(interpolate_13.Curve)
interpolate_15 = Interpolate(Vertices=construct_point_15, Degree=3, Periodic=False, KnotStyle=1)  # -> Curve, Length, Domain
curve_14 = Curve(interpolate_15.Curve)
curve_15 = Curve(interpolate_14.Curve)
